# Grasshopper definition grasshopper.gh (Grasshopper 1.0.7)

# Square Shape
number_slider = Slider(5, range=0..7)
number_slider_2 = Slider(8, range=0..10)
number_slider_3 = Slider(14.28, range=5..100)
# Hexagon Shape
number_slider_4 = Slider(5, range=0..7)
number_slider_5 = Slider(8, range=0..10)
number_slider_6 = Slider(14.28, range=5..100)
number_slider_7 = Slider(14.28, range=5..100)
number_slider_8 = Slider(20, range=0..50)
number_slider_9 = Slider(20, range=0..50)
# Hexagon Shape
number_slider_10 = Slider(5, range=0..7)
number_slider_11 = Slider(8, range=0..10)
division = Division()
division_2 = Division(A=number_slider, B=-2)
number_slider_12 = Slider(14.28, range=0..50)
division_3 = Division(A=number_slider_4, B=-2)
number_slider_13 = Slider(14.28, range=0..50)
subtraction = Subtraction(A=number_slider_3)
# rectangle cutouts
rectangle = Rectangle(Plane=PlaneXY(0, 0, 0), XSize=number_slider, YSize=number_slider_2, Radius=0)  # -> Rectangle, Length
rectangle_2 = Rectangle(Plane=PlaneXY(0, 0, 0), XSize=number_slider_4, YSize=number_slider_5, Radius=0)  # -> Rectangle, Length
curve = Curve(<curve referenced from the Rhino model>)
subtraction_2 = Subtraction(A=number_slider_8, B=number_slider_2)
subtraction_3 = Subtraction(A=number_slider_9, B=number_slider_5)
# making the hexagon shape
number_slider_14 = Slider(6.508, range=0..50)
vector_xyz = VectorXYZ(XComponent=0, YComponent=0, ZComponent=0)  # -> Vector, Length
# making the square shape
polygon = Polygon(Plane=PlaneXY(0, 0, 0), Radius=number_slider_8, Segments=Slider(4, range=0..50), FilletRadius=0)  # -> Polygon, Length
polygon_2 = Polygon(Plane=PlaneXY(0, 0, 0), Radius=number_slider_9, Segments=Slider(6, range=0..50), FilletRadius=0)  # -> Polygon, Length
division_4 = Division(A=number_slider_10, B=-2)
rectangle_3 = Rectangle(Plane=PlaneXY(0, 0, 0), XSize=number_slider_10, YSize=number_slider_11, Radius=0)  # -> Rectangle, Length
subtraction_4 = Subtraction(A=number_slider_12, B=number_slider_11)
circle_cnr = CircleCNR(Center=Point(0, 40, 0), Normal=Vector(0, 0, 1), Radius=number_slider_3)
vector_xyz_2 = VectorXYZ(XComponent=division_2, YComponent=subtraction_2, ZComponent=0)  # -> Vector, Length
move = Move(Geometry=rectangle.Rectangle, Motion=vector_xyz_2.Vector)  # -> Geometry, Transform
vector_xyz_3 = VectorXYZ(XComponent=division_3, YComponent=subtraction_3, ZComponent=0)  # -> Vector, Length
move_2 = Move(Geometry=rectangle_2.Rectangle, Motion=vector_xyz_3.Vector)  # -> Geometry, Transform
# making the hexagon shape
circle_cnr_2 = CircleCNR(Center=Point(0, 0, 0), Normal=Vector(0, 0, 1), Radius=number_slider_12)
# creating the 3D shape that can be variable
vector_xyz_4 = VectorXYZ(XComponent=0, YComponent=0, ZComponent=number_slider_14)  # -> Vector, Length
# creating the 3D shape that can be variable
number_slider_15 = Slider(6.508, range=0..50)
move_3 = Move(Geometry=curve, Motion=vector_xyz.Vector)  # -> Geometry, Transform
vector_xyz_5 = VectorXYZ(XComponent=division_4, YComponent=subtraction_4, ZComponent=0)  # -> Vector, Length
move_4 = Move(Geometry=rectangle_3.Rectangle, Motion=vector_xyz_5.Vector)  # -> Geometry, Transform
surface = Surface(polygon_2.Polygon)
polar_array = PolarArray(Geometry=move_3.Geometry, Plane=PlaneXY(0, 0, 0), Count=10, Angle=6.283185307)  # -> Geometry, Transform
polar_array_2 = PolarArray(Geometry=move.Geometry, Plane=PlaneXY(0, 0, 0), Count=Slider(4, range=0..7), Angle=6.283185307)  # -> Geometry, Transform
# baking for 3d shape
extrude = Extrude(Base=surface, Direction=vector_xyz_4.Vector)
# creating the 3D shape that can be variable
number_slider_16 = Slider(0.349, range=0..1)
polar_array_3 = PolarArray(Geometry=move_2.Geometry, Plane=PlaneXY(0, 0, 0), Count=Slider(4, range=0..7), Angle=6.283185307)  # -> Geometry, Transform
vector_xyz_6 = VectorXYZ(XComponent=0, YComponent=0, ZComponent=number_slider_15)  # -> Vector, Length
polar_array_4 = PolarArray(Geometry=move_4.Geometry, Plane=PlaneXY(0, 0, 0), Count=Slider(4, range=0..10), Angle=6.283185307)  # -> Geometry, Transform
surface_2 = Surface(polygon.Polygon)
trim_with_regions = TrimWithRegions(Curve=polygon.Polygon, Regions=polar_array_2.Geometry)  # -> Inside, Outside
# trimming the desired shape
trim_with_regions_2 = TrimWithRegions(Curve=polar_array_2.Geometry, Regions=polygon.Polygon)  # -> flatten(Inside), Outside
trim_with_regions_3 = TrimWithRegions(Curve=polygon_2.Polygon, Regions=polar_array_3.Geometry)  # -> Inside, Outside
# trimming the desired shape
trim_with_regions_4 = TrimWithRegions(Curve=polar_array_3.Geometry, Regions=polygon_2.Polygon)  # -> flatten(Inside), Outside
# baking for 3d shape
extrude_2 = Extrude(Base=surface_2, Direction=vector_xyz_6.Vector)
# baking for 3d shape
trim_with_regions_5 = TrimWithRegions(Curve=circle_cnr_2, Regions=polar_array_4.Geometry)  # -> Inside, Outside
# trimming the desired shape
trim_with_regions_6 = TrimWithRegions(Curve=polar_array_4.Geometry, Regions=circle_cnr_2)  # -> flatten(Inside), Outside
# baking after joining
join_curves = JoinCurves(Curves=[trim_with_regions.Outside, trim_with_regions_2.Inside], Preserve=False)
# baking after joining
join_curves_2 = JoinCurves(Curves=[trim_with_regions_3.Outside, trim_with_regions_4.Inside], Preserve=False)
# baking after joining
join_curves_3 = JoinCurves(Curves=[trim_with_regions_5.Outside, trim_with_regions_6.Inside], Preserve=False)
